# Dynamo graph Duct loss Example.dyn "Sharable Version" (Dynamo 2.19.3.6394)

# note: If you select for your last selection a duct that has another conneciton with an element not in your route(such as a duct that continues on) you will get an error. Typically you would select ending element such as a air terminal. If it does get a duct that has connecitons not in the route it will return a null for those.
# The ducts
# Example of a bad selelction. [[duct, duct,], [duct, null]]

# group: Start Input
# note: Your first selection should be equipment, fitting, or accessory.
# Note: A Duct can be selected if it doesn't have taps.

# group: Temporary Isolate Elments in Active View.
# note: Temporary Isolate Elements in View

select_model_element = DSModelElementSelection()  # 1 picked in the model; graph input
select_model_element_2 = DSModelElementSelection()  # 1 picked in the model; graph input

# group: Main Path - No Branches
python_gets_duct_route = Python(IN[0]=select_model_element, IN[1]=select_model_element_2)  # CPython3
# ---------- python_gets_duct_route.python (103 lines) ----------
import os
import math
import clr
from collections import deque

clr.AddReference('RevitAPI')
clr.AddReference('RevitAPIUI')
clr.AddReference('RevitServices')
clr.AddReference("RevitNodes")

from Autodesk.Revit.DB import *
from Autodesk.Revit.UI import UIApplication, TaskDialog
import Autodesk

import Revit
clr.ImportExtensions(Revit.Elements)
clr.ImportExtensions(Revit.GeometryConversion)

from RevitServices.Persistence import DocumentManager
from RevitServices.Transactions import TransactionManager

doc = DocumentManager.Instance.CurrentDBDocument
uidoc = DocumentManager.Instance.CurrentUIApplication.ActiveUIDocument

#Preparing input from dynamo to revit
start = UnwrapElement(IN[0])
end = UnwrapElement(IN[1])
  
    
def get_connected_elements(duct):
    try:
        connectors = duct.ConnectorManager.Connectors
    except:
        connectors = duct.MEPModel.ConnectorManager.Connectors
    connected_elements = []
    for connector in connectors:
        for connected_connector in connector.AllRefs:
            connected_element = connected_connector.Owner
            if connected_element.Id != duct.Id and connected_element.Category.Name != "Duct Systems":
                connected_elements.append(connected_element)
    return connected_elements
    return connected_elements





def is_reachable(node, target, visited=None):
    if visited is None:
        visited = set()

    if node.Id == target.Id:
        return True

    if node.Id in visited:
        return False

    visited.add(node.Id)
    connected_elements = get_connected_elements(node)

    for element in connected_elements:
        if element.Id not in visited and is_reachable(element, target, visited):
            return True

    return False


def find_path(start_duct, end_duct, visited=None, path=None):
    if visited is None:
        visited = set()
    if path is None:
        path = []

    visited.add(start_duct.Id)
    path.append(start_duct)

    if start_duct.Id == end_duct.Id:
        return path

    connected_elements = get_connected_elements(start_duct)
    
    for element in connected_elements:
        if element.Id not in visited:
            # Check if the end duct is reachable from the current element
            if is_reachable(element, end_duct):
                result = find_path(element, end_duct, visited, path)
                if result:
                    return result

    path.pop()
    visited.remove(start_duct.Id)

    return None






complete_path = find_path(start, end)
OUT = complete_path
            
           
# ----------------------------------------

identity = Object.Identity(object=python_gets_duct_route)
# note: This finds ducts that have taps.
python_script = Python(IN[0]=identity)  # CPython3
# ---------- python_script.python (29 lines) ----------
#from Autodesk.Revit.DB import BuiltInCategory, ElementId

def has_multiple_connections(i, duct, path):
    try:
        connectors = duct.ConnectorManager.Connectors
    except:
        connectors = duct.MEPModel.ConnectorManager.Connectors
    connected_fittings = []
    for connector in connectors:
        for connected_connector in connector.AllRefs:
            connected_element = connected_connector.Owner
            if connected_element.Category.Name == "Duct Fittings" and connected_element.Id not in [e.Id for e in path]:
                connected_fittings.append(connected_element)
    if len(connected_fittings) > 0:
        prev_element = None if i == 0 else path[i - 1]
        next_element = None if i == len(path) - 1 else path[i + 1]
        tuple_elements = (prev_element, duct, next_element)
        # Checking for the None scenario you mentioned and replacing the last element in the tuple if it's None
        if tuple_elements[-1] is None:
            tuple_elements = None
        return tuple_elements
    else:
        return None

sys = UnwrapElement(IN[0])
OUT = []

for i, duct in enumerate(sys):
    OUT.append(has_multiple_connections(i, duct, sys))
# ----------------------------------------
identity_2 = Object.Identity(object=python_script)
# note: Update python to exclude index and elements if the elements list is empty
python_script_2 = Python(IN[0]=identity_2)  # CPython3
# ---------- python_script_2.python (150 lines) ----------
import clr

# Add RevitAPIUI and RevitAPI references

clr.AddReference('RevitAPI')

from Autodesk.Revit.DB import ElementId, BuiltInCategory, XYZ, Line



"""
Main Code Execution:

Iterates over each element in the provided elems list. Each element in this list is expected to be a tuple or list of three ducts.

It uses the get_connection_point function to determine the connection points and the list of other elements connected to the second duct.

Then, it uses filter_and_sort_ducts to filter and sort these connected elements based on their distance to the connection points.

The sorted list of elements, along with their index in the main elems list, is appended to the OUT list.

"""




# Preparing input from Dynamo to Revit
elems = UnwrapElement(IN[0])


def xyz_to_tuple(revit_xyz):
    return (revit_xyz.X, revit_xyz.Y, revit_xyz.Z)
    
def get_connection_point(duct2,duct1=None, duct3=None):
    if duct1 is not None:
        try:
            connectors1 = duct1.ConnectorManager.Connectors
        except:
            connectors1 = duct1.MEPModel.ConnectorManager.Connectors

    try:
        connectors2 = duct2.ConnectorManager.Connectors
    except:
        connectors2 = duct2.MEPModel.ConnectorManager.Connectors

    start_point = None
    end_point = None
    connected_elements = []

    if duct1 is not None:
        for connector1 in connectors1:
            for connector2 in connectors2:
                if connector1.IsConnectedTo(connector2):
                    start_point = connector1.Origin
                    start_point = xyz_to_tuple(start_point)

    if duct3 is not None:
        try:
            connectors3 = duct3.ConnectorManager.Connectors
        except:
            connectors3 = duct3.MEPModel.ConnectorManager.Connectors

        for connector2 in connectors2:
            for connector3 in connectors3:
                if connector2.IsConnectedTo(connector3):
                    end_point = connector2.Origin
                    end_point = xyz_to_tuple(end_point)
                    break

            if end_point is not None:
                break

    for connector2 in connectors2:
        for connected_connector in connector2.AllRefs:
            connected_element = connected_connector.Owner
            if connected_element.Category.Id == ElementId(BuiltInCategory.OST_MechanicalEquipment) or connected_element.Category.Id == ElementId(BuiltInCategory.OST_DuctCurves):
                continue
            if duct1 is not None and connected_element.Id == duct1.Id:
                continue
            if duct3 is not None and connected_element.Id == duct3.Id:
                continue
            if connected_element.Category.Id == ElementId(BuiltInCategory.OST_DuctSystem):
                continue
            connected_elements.append(connected_element)

    return start_point, end_point, connected_elements



def distance_to_line(point, line_start, line_end):
    line_dir = (line_end - line_start).Normalize()
    vector_to_point = point - line_start
    proj_length = vector_to_point.DotProduct(line_dir)
    proj_point = line_start + proj_length * line_dir
    return point.DistanceTo(proj_point)

def filter_and_sort_ducts(start_tuple=None, end_tuple=None, ducts=None):
    if ducts is None:
        ducts = []

    if start_tuple is not None:
        start_xyz = XYZ(*start_tuple)
    if end_tuple is not None:
        end_xyz = XYZ(*end_tuple)

    if start_tuple is not None and end_tuple is not None:
        line = Line.CreateBound(start_xyz, end_xyz)

    ducts_within_range = []
    for duct in ducts:
        try:
            connector_manager = duct.ConnectorManager
        except:
            connector_manager = duct.MEPModel.ConnectorManager
        if connector_manager:
            for connector in connector_manager.Connectors:
                point = connector.Origin

                if start_tuple is not None and end_tuple is not None:
                    distance_to_start = point.DistanceTo(start_xyz)
                    distance_to_end = point.DistanceTo(end_xyz)

                    # Check if the point is within the range
                    if distance_to_start <= start_xyz.DistanceTo(end_xyz) and distance_to_end <= start_xyz.DistanceTo(end_xyz):
                        ducts_within_range.append((duct, distance_to_start))
                        break
                elif start_tuple is not None:
                    distance_to_start = point.DistanceTo(start_xyz)
                    ducts_within_range.append((duct, distance_to_start))
                    break
                elif end_tuple is not None:
                    distance_to_end = point.DistanceTo(end_xyz)
                    ducts_within_range.append((duct, distance_to_end))
                    break

    # Sort the ducts by their distance from the start point or endpoint, whichever is available
    sorted_ducts = sorted(ducts_within_range, key=lambda x: x[1])

    # Return the list of duct elements, ordered by distance from the start point or endpoint
    return [duct for duct, distance in sorted_ducts]

OUT = []
for index, i in enumerate(elems):
    if i:
        duct1 = i[0]
        duct2 = i[1]
        duct3 = i[2]
  
        start, end, elems, = get_connection_point(duct2,duct1,duct3)
        OUT.append([index, filter_and_sort_ducts(start, end, elems)])
# ----------------------------------------
isEmpty = List.IsEmpty(list=python_script_2@@L2)
anyTrue = List.AnyTrue(list=isEmpty@L2)
dialog_alert = Python(IN[0]=identity)  # CPython3
# ---------- dialog_alert.python (11 lines) ----------
import clr
clr.AddReference('RevitAPIUI')

from Autodesk.Revit.UI import UIApplication, TaskDialog
complete_path = IN[0]

if not complete_path:
    msg = "Please ensure that the duct system is fully connected. To quickly identify any disconnected paths, tab into the duct to highlight the entire system, revealing any unconnected sections."
    title = "Incomplete Duct System Connection"
    alert = TaskDialog
    OUT = alert.Show(title, msg)
# ----------------------------------------
file_path = Filename("No file selected.")  # graph input
new_sheet_name = StringInput("")  # graph input
isolate_elements_in_view = BoolSelector(true)  # graph input

# group: Isolate Elements in View
current = Document.Current()
activeView = Document.ActiveView(document=current)
code_block = CodeBlock { []; }
if_ = RefactoredIf(test=isolate_elements_in_view, true=activeView, false=code_block)
isolateElementsTemporary = View.IsolateElementsTemporary(view=if_, elements=identity)
