# Dynamo graph Reference Planes from CAD.dyn (Dynamo 2.16.2.5624)
# packages: bimorphNodes 4.1.2, Data-Shapes 2022.2.103, Rhythm 2022.1.5

element_types = ElementTypes("CADLinkType")
all_elements_of_type = ElementsOfType(element_type=element_types)
getCategory = Element.GetCategory(element=all_elements_of_type)
all_elements_of_category = ElementsOfCategory(Category=getCategory)
flatten = List.Flatten(list=all_elements_of_category)
uniqueItems = List.UniqueItems(list=flatten)
code_block = CodeBlock { "Name"; }
getParameterValueByName = Element.GetParameterValueByName(element=uniqueItems, parameterName=code_block)
code_block_2 = CodeBlock { 0; }
listview_data = Custom[Listview Data](Keys=getParameterValueByName, Values=uniqueItems, ShowId_optionnal=code_block_2)  # package Data-Shapes; Create data for ListView input in UI.MultiInputForm ++ . Check out www.data-shapes.net for more infos.
code_block_3 = CodeBlock { 1; }
multipleinputform = Custom[MultipleInputForm ++](Inputs=listview_data, Toggle=code_block_3)  # package Data-Shapes; Create a form with multiple inputs. see www.data-shapes.net for tutorials and infos!
end = Revit.Transaction.Transaction.End(input=multipleinputform.User_Inputs)
start = Revit.Transaction.Transaction.Start(input=end)
code_block_4 = CodeBlock { ["Wall Layers", "Non-Wall Layers"]; }
layerNames = Revit.ImportInstance.LayerNames(importInstance=multipleinputform.User_Inputs)
flatten_2 = List.Flatten(list=layerNames)
uniqueItems_2 = List.UniqueItems(list=flatten_2)
code_block_5 = CodeBlock { "Wall"; }
code_block_6 = CodeBlock { 1; }
contains = String.Contains(string=uniqueItems_2, searchFor=code_block_5, ignoreCase=code_block_6)
filterByBoolMask = List.FilterByBoolMask(list=uniqueItems_2, mask=contains)
list_create = List.Create(item0=filterByBoolMask.in, item1=filterByBoolMask.out)
code_block_7 = CodeBlock { 0; }
listview_data_2 = Custom[Listview Data](InputName=code_block_4@L1, Keys=list_create@L2, Values=list_create@L2, ShowId_optionnal=code_block_7)
code_block_8 = CodeBlock { 1; }
multipleinputform_2 = Custom[MultipleInputForm ++](Inputs=listview_data_2, Toggle=code_block_8)
flatten_3 = List.Flatten(list=multipleinputform_2.User_Inputs)
curvesFromCADLayers = CAD.CurvesFromCADLayers(importInstance=start, layerNames=flatten_3)
code_block_9 = CodeBlock { 0; }
clean = List.Clean(list=curvesFromCADLayers.Curve, preserveIndices=code_block_9)
flatten_4 = List.Flatten(list=clean@L3)
length = Curve.Length(curve=flatten_4)
code_block_10 = CodeBlock { 1.5; }
le = length <= code_block_10
filterByBoolMask_2 = List.FilterByBoolMask(list=flatten_4, mask=le)
type = Object.Type(object=filterByBoolMask_2.out)
code_block_11 = CodeBlock { "Line"; }
contains_2 = String.Contains(string=type, searchFor=code_block_11)
filterByBoolMask_3 = List.FilterByBoolMask(list=filterByBoolMask_2.out, mask=contains_2)
ʳʰʸᵗʰᵐ_referenceplanes_byline = Rhythm.Revit.Elements.ReferencePlanes.ByLine(curve=filterByBoolMask_3.in)
code_block_12 = CodeBlock { "Name"; }
code_block_13 = CodeBlock { 1; }
count = List.Count(list=ʳʰʸᵗʰᵐ_referenceplanes_byline@L2)
range = Range(start=code_block_13, end=count)
string_from_object = FromObject(object=range)
flatten_5 = List.Flatten(list=multipleinputform.User_Inputs)
code_block_14 = CodeBlock { "Name"; }
getParameterValueByName_2 = Element.GetParameterValueByName(element=flatten_5, parameterName=code_block_14)
python_script = Python(IN[0]=getParameterValueByName_2)  # CPython3
# ---------- python_script.python (14 lines) ----------
import re

def remove_special_chars(input_string):
    # This regular expression will match any character that is not a letter, a digit or an underscore
    pattern = re.compile(r'\W+')
    
    # Using the pattern, replace all special characters in the input string with nothing
    output_string = re.sub(pattern, '', input_string)
    
    return output_string
OUT = []
data = IN[0]
for i in data:
	OUT.append(remove_special_chars(i))
# ----------------------------------------
code_block_15 = CodeBlock(x=python_script) { " " + x; }
add = string_from_object@L2 + code_block_15@L1
setParameterByName = Element.SetParameterByName(element=ʳʰʸᵗʰᵐ_referenceplanes_byline@L1, parameterName=code_block_12, value=add@L1)
